# Grasshopper definition HopsTest.gh (Grasshopper 1.0.7)

get_count = GetInteger(AtLeast=1, AtMost=2147483647, Maximum=2147483647, Minimum=-2147483648)
get_curve = GetGeometry(AtLeast=1, AtMost=1, DeleteInput=False, Filter=1073741828)
divide_curve = DivideCurve(Curve=get_curve, Count=get_count, Kinks=False)  # -> Points, Tangents, Parameters

# ---- group: RH_OUT:Points
point = Point(divide_curve.Points)
